# Grasshopper definition CamAndFollowerTrial.gh (Grasshopper 1.0.7)
# plug-ins: Human UI

xy = XYPlane(Origin=Point(0, 0, 0))
pt = Point(Point(-0.04559998608, 12.6051502, 0))
pt_2 = Point(Point(-0.1925703683, 19.2188174, 0))
camandfollower = CamAndFollower(
    BasePlane=xy,
    CamType=Slider(2, range=0..10),
    FollowerType=Slider(1, range=0..1),
    FirstPoint=pt,
    SecondPoint=pt_2,
    MinimalRadiusOfCam=Slider(6, range=0..10),
    MaximumRadiusOfCam=Slider(10, range=0..10),
    RodRadiusOfFollower=Slider(1, range=0..1),
    InitialPositionOfCam=Slider(0, range=0..1080))  # -> Cam, Follower, Models
