# Grasshopper definition PreprocessTrialNew3.gh (Grasshopper 1.0.7)
# plug-ins: Human UI

number_slider = Slider(1, range=0..1)
brep = Brep(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)
regionselection = RegionSelection(Brep=brep, Restart=Button(), SelectDirection=Toggle(True), SelectRegion=Toggle(True))  # -> ModelRegionOfInterest, InnerCavity, Skeleton, Direction
